# Grasshopper definition cb.gh (Grasshopper 1.0.7)
# plug-ins: Culebra_GH, LunchBox

# ---- group: TRAIL GRAPHICS OPTION 1
construct_domain = ConstructDomain(DomainStart=Slider(0, range=0..255), DomainEnd=Slider(255, range=0..255))
construct_domain_2 = ConstructDomain(DomainStart=Slider(255, range=0..255), DomainEnd=Slider(0, range=0..255))
construct_domain_3 = ConstructDomain(DomainStart=Slider(255, range=0..255), DomainEnd=Slider(68.35, range=0..255))

construct_domain_4 = ConstructDomain(DomainStart=Slider(0, range=0..255), DomainEnd=Slider(0, range=0..255))
construct_domain_5 = ConstructDomain(DomainStart=Slider(0, range=0..255), DomainEnd=Slider(0, range=0..255))
construct_domain_6 = ConstructDomain(DomainStart=Slider(0, range=0..255), DomainEnd=Slider(0, range=0..255))

# ----
your_surface_from_rhino = Surface(<surface referenced from the Rhino model>)
curve = Curve([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])
curve_2 = Curve([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])
hex = HexagonCells(Surface=your_surface_from_rhino, UDivisions=Slider(10, range=0..10), VDivisions=Slider(7, range=0..10), TParameter=0.25)  # -> HexagonCells, graft(Centers)

# ---- group: TRAIL GRAPHICS OPTION 2
number_slider = Slider(1, range=0..10)
boolean_toggle = BooleanToggle(True)
colour_rgb = ColourRGB(Alpha=255, Red=Slider(0, range=0..255), Green=Slider(255, range=0..255), Blue=Slider(26.56, range=0..255))

number_slider_2 = Slider(1, range=0..10)
boolean_toggle_2 = BooleanToggle(True)
colour_rgb_2 = ColourRGB(Alpha=255, Red=Slider(0, range=0..255), Green=Slider(255, range=0..255), Blue=Slider(26.56, range=0..255))

# ---- group: SPAWN SETTINGS
point = Point([Point(157.4957382, 148.9825217, 0), Point(151.6517657, 111.727197, 0), Point(149.460276, 32.8335682, 0), Point(138.5028275, -78.9324059, 0), Point(88.09856469, -187.0458972, 0), Point(7.013446228, -202.386325, 0)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])
bounding_box = BoundingBox(Content=point, Plane=PlaneXY(0, 0, 0), UnionBox=True)  # -> Box, Box_2

# ----
crv = Curve(graft(hex.HexagonCells))

# ---- group: 2D CURVES
curve_3 = Curve(crv)

# ---- group: SPAWN SETTINGS
# 2D MULTI PATH FOLLOWING + WANDERING DEMO FILE
# POLYLINE RESOLUTION IS IMPORTANT, KEEP AS LOW AS POSSIBLE
spawn_location = ValueList({"2D Aligned or 3D Random on Ground": 0, "2D Random Scattered in box or 3D Random Scattered in Box": 1}, selected="2D Random Scattered in box or 3D Random Scattered in Box")
number_slider_3 = Slider(2000, range=0..20000)
bounding_box_2 = BoundingBox(Content=curve_3, Plane=PlaneXY(0, 0, 0), UnionBox=True)  # -> Box, Box_2

# ---- group: TRAIL GRAPHICS OPTION 3
number_slider_4 = Slider(1, range=0..1)
number_slider_5 = Slider(3, range=0..10)

# ---- group: TRAIL GRAPHICS OPTION 1
number_slider_6 = Slider(1, range=0..5)
number_slider_7 = Slider(2, range=0..10)
file_path = FilePath("E:\Documents\ComplicitMatter_SourceTree\C#\Culebra\textures\texture.png")

# ----
value_list = ValueList({"Type A - 2D & 3D": 0, "Type B - 3D": 1, "Type C - 3D": 2}, selected="Type A - 2D & 3D")

Z = UnitZ(Factor=Slider(100, range=0..100))

# ---- group: SPAWN SETTINGS
point_2 = Point([Point(157.4957382, 148.9825217, 0), Point(151.6517657, 111.727197, 0), Point(149.460276, 32.8335682, 0), Point(138.5028275, -78.9324059, 0), Point(88.09856469, -187.0458972, 0), Point(7.013446228, -202.386325, 0)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])
bounding_box_3 = BoundingBox(Content=point_2, Plane=PlaneXY(0, 0, 0), UnionBox=True)  # -> Box, Box_2

# ---- group: TRAIL GRAPHICS OPTION 3
number_slider_8 = Slider(1, range=0..1)
number_slider_9 = Slider(3, range=0..10)

# ---- group: TRAIL GRAPHICS OPTION 1
number_slider_10 = Slider(1, range=0..5)
number_slider_11 = Slider(3, range=0..10)
file_path_2 = FilePath("E:\Documents\ComplicitMatter_SourceTree\C#\Culebra\textures\texture.png")

# ----
debrep = DeconstructBrep(Brep=crv)  # -> Faces, Edges, Vertices
extr = Extrude(Base=crv, Direction=Z)

value_list_2 = ValueList({"Type A - 2D & 3D": 0, "Type B - 3D": 1, "Type C - 3D": 2}, selected="Type C - 3D")

# ---- group: SPAWN SETTINGS / BOX SPAWN TYPE
box_spawn = BoxSpawn(Box=bounding_box_2.Box, SpawnLocation=spawn_location, SpawnCount=number_slider_3)

# ---- group: SPAWN SETTINGS / POINT SPAWN TYPE
point_spawn = PointSpawn(Points=point, Box=bounding_box.Box)

# ----
pt = Point(debrep.Vertices)
debrep_2 = DeconstructBrep(Brep=extr)  # -> Faces, Edges, Vertices

# ---- group: SPAWN SETTINGS / POINT SPAWN TYPE
point_spawn_2 = PointSpawn(Points=point_2, Box=bounding_box_3.Box)

# ---- group: TRAIL GRAPHICS OPTION 2 / GRAPHIC POLYLINE TRAIL
graphic_polyline = Graphic_Polyline(Color=colour_rgb, Dotted=boolean_toggle, Thickness=number_slider)

# ---- group: TRAIL GRAPHICS OPTION 1 / GRADIENT TRAILS
gradient_color = Gradient_Color(
    RedChannel=construct_domain,
    GreenChannel=construct_domain_2,
    BlueChannel=construct_domain_3,
    MinimumThickness=number_slider_6,
    MaximumThickness=number_slider_7)

# ---- group: TRAIL GRAPHICS OPTION 3 / DISCO TRAILS
# VISUALS
disco_color = Disco_Color(MinimumThickness=number_slider_4, MaximumThickness=number_slider_5)

# ---- group: MULTI PATH FOLLOWING
multi_path_tracking = MultiPathTracking(
    Polylines=curve_3,
    PolylineThreshold=Slider(260.79, range=0..1000),
    ProjectionDistance=Slider(30.88, range=0..100),
    PolylineRadius=Slider(13.75, range=0..50))

# ---- group: WEAVING WANDERING
weaving_wandering = WeavingWandering(
    Change=Slider(100, range=0..100),
    Radius=Slider(20, range=0..1000),
    Distance=Slider(15, range=0..200),
    RotationTrigger=Slider(6, range=0..100),
    Type=value_list)

# ----
crv_2 = Curve(debrep_2.Edges)

# ---- group: TRAIL GRAPHICS OPTION 2 / GRAPHIC POLYLINE TRAIL
graphic_polyline_2 = Graphic_Polyline(Color=colour_rgb_2, Dotted=boolean_toggle_2, Thickness=number_slider_2)

# ---- group: TRAIL GRAPHICS OPTION 1 / GRADIENT TRAILS
gradient_color_2 = Gradient_Color(
    RedChannel=construct_domain_4,
    GreenChannel=construct_domain_5,
    BlueChannel=construct_domain_6,
    MinimumThickness=number_slider_10,
    MaximumThickness=number_slider_11)

# ---- group: TRAIL GRAPHICS OPTION 3 / DISCO TRAILS
# VISUALS
disco_color_2 = Disco_Color(MinimumThickness=number_slider_8, MaximumThickness=number_slider_9)

# ---- group: TRAIL DATA
trail_data = TrailData(Trail=Toggle(True), TrailStep=Slider(0, range=0..10), MaxTrailSize=Slider(150, range=0..1000))

# ---- group: WEAVING WANDERING
weaving_wandering_2 = WeavingWandering(
    Change=Slider(100, range=0..100),
    Radius=Slider(20, range=0..1000),
    Distance=Slider(15, range=0..200),
    RotationTrigger=Slider(6, range=0..100),
    Type=value_list_2)

# ----
join = JoinCurves(Curves=flatten(crv_2), Preserve=False)

# ----
# POLYLINE RESOLUTION IS IMPORTANT, KEEP AS LOW AS POSSIBLE
number_slider_12 = Slider(20, range=0..100)
curve_4 = Curve(join)
rebuild_curve = RebuildCurve(Curve=curve_4, Degree=1, Count=number_slider_12, Tangents=False)

# ---- group: 3D CURVES
curve_5 = Curve(rebuild_curve)

# ---- group: SPAWN SETTINGS
# 3D MULTI PATH FOLLOWING + WANDERING DEMO FILE
spawn_location_2 = ValueList({"2D Aligned or 3D Random on Ground": 0, "2D Random Scattered in box or 3D Random Scattered in Box": 1}, selected="2D Aligned or 3D Random on Ground")
number_slider_13 = Slider(1000, range=0..20000)
bounding_box_4 = BoundingBox(Content=curve_5, Plane=PlaneXY(0, 0, 0), UnionBox=True)  # -> Box, Box_2

# ---- group: SPAWN SETTINGS / BOX SPAWN TYPE
box_spawn_2 = BoxSpawn(Box=bounding_box_4.Box, SpawnLocation=spawn_location_2, SpawnCount=number_slider_13)

# ---- group: MULTI PATH FOLLOWING
multi_path_tracking_2 = MultiPathTracking(
    Polylines=curve_5,
    PolylineThreshold=Slider(500, range=0..1000),
    ProjectionDistance=Slider(30.88, range=0..100),
    PolylineRadius=Slider(25, range=0..50))

# ---- group: TRAIL DATA
trail_data_2 = TrailData(Trail=Toggle(True), TrailStep=Slider(0, range=0..10), MaxTrailSize=Slider(5000, range=0..5000))

# ----
init_move = Slider(0.8, range=0..10)
max_speed = Slider(3.74, range=0..10)
force = Slider(0.3, range=0..10)
n_a_for_tracking = Slider(1.27, range=0..10)

bounds = ValueList({"Bounce": 0, "Respawn": 1, "None": 2}, selected="None")
dimension = ValueList({"2D": 0, "3D": 1}, selected="2D")

pipe = Pipe(Curve=join, Radius=1, Caps=0)

bounds_2 = ValueList({"Bounce": 0, "Respawn": 1, "None": 2}, selected="None")
dimension_2 = ValueList({"2D": 0, "3D": 1}, selected="3D")

init_move_2 = Slider(0.8, range=0..10)
max_speed_2 = Slider(4, range=0..10)
force_2 = Slider(1, range=0..10)
n_a_for_tracking_2 = Slider(1.27, range=0..10)

value_list_3 = ValueList({"Graphic": 0, "Geometry": 1}, selected="Graphic")

value_list_4 = ValueList({"Graphic": 0, "Geometry": 1}, selected="Geometry")

# ---- group: INIT SETTINGS
# ALL SETTINGS
init_settings = InitSettings(SpawnSettings=box_spawn, Dimension=dimension, Boundary=bounds)

# ---- group: CONTROLLER
controller = Controller(Multi_Path_Tracking=multi_path_tracking, Weaving_Wandering=weaving_wandering)

# ---- group: MOVE SETTINGS
move_settings = MoveSettings(InitialSpeedVector=init_move, MaxSpeed=max_speed, MaxForce=force, VelocityMultiplier=n_a_for_tracking)

# ---- group: INIT SETTINGS
# ALL SETTINGS
init_settings_2 = InitSettings(SpawnSettings=box_spawn_2, Dimension=dimension_2, Boundary=bounds_2)

# ---- group: CONTROLLER
controller_2 = Controller(Multi_Path_Tracking=multi_path_tracking_2, Weaving_Wandering=weaving_wandering_2)

# ---- group: VISUAL SETTINGS
# BEHAVIORS
visual_settings = VisualSettings(TrailData=trail_data, ColorData=gradient_color, ApplyTexture=Toggle(False), DisplayMode=value_list_3)

# ---- group: MOVE SETTINGS
move_settings_2 = MoveSettings(InitialSpeedVector=init_move_2, MaxSpeed=max_speed_2, MaxForce=force_2, VelocityMultiplier=n_a_for_tracking_2)

# ---- group: VISUAL SETTINGS
# BEHAVIORS
visual_settings_2 = VisualSettings(TrailData=trail_data_2, ColorData=gradient_color_2, ApplyTexture=Toggle(False), DisplayMode=value_list_4)

# ---- group: CREEPER ENGINE
# ENGINE (Single)
button = Button()
timer = Timer(Interval=1, TimerInterval=5, Target=creeper_engine_test)  # disabled

# ENGINE (Single)
button_2 = Button()
timer_2 = Timer(Interval=1, TimerInterval=5, Target=creeper_engine_test_2)  # disabled

# ---- group: CREEPER ENGINE / Engine
creeper_engine_test = Creeper_Engine_Test(
    InitSettings=init_settings,
    MoveSettings=move_settings,
    BehavioralSettings=controller,
    VisualSettings=visual_settings,
    Reset=button)  # -> Creepers, Trails, Connectivity; disabled

creeper_engine_test_2 = Creeper_Engine_Test(
    InitSettings=init_settings_2,
    MoveSettings=move_settings_2,
    BehavioralSettings=controller_2,
    VisualSettings=visual_settings_2,
    Reset=button_2)  # -> Creepers, Trails, Connectivity

# ---- group: CREEPER ENGINE
interpolate = Interpolate(Vertices=creeper_engine_test.Trails, Degree=1, Periodic=False, KnotStyle=1)  # -> flatten(Curve), Length, Domain
custom_preview = CustomPreview(Geometry=interpolate.Curve, Shader=ColourSwatch(SwatchColor=RGB(161, 161, 161)))
custom_preview_2 = CustomPreview(Geometry=creeper_engine_test.Connectivity, Shader=ColourSwatch(SwatchColor=RGB(92, 91, 91)))
custom_preview_3 = CustomPreview(Shader=ColourSwatch(SwatchColor=RGB(128, 128, 128)))
cloud_display = CloudDisplay(Points=creeper_engine_test.Creepers, Colours=RGB(255, 20, 147), Size=Slider(1, range=0..10), SpriteType=0)

interpolate_2 = Interpolate(Vertices=creeper_engine_test_2.Trails, Degree=1, Periodic=False, KnotStyle=1)  # -> flatten(Curve), Length, Domain
custom_preview_4 = CustomPreview(Geometry=interpolate_2.Curve, Shader=ColourSwatch(SwatchColor=RGB(171, 171, 171)))
custom_preview_5 = CustomPreview(Shader=ColourSwatch(SwatchColor=RGB(235, 235, 235)))
custom_preview_6 = CustomPreview(Geometry=creeper_engine_test_2.Connectivity, Shader=ColourSwatch(SwatchColor=RGB(0, 0, 0)))
cloud_display_2 = CloudDisplay(Points=creeper_engine_test_2.Creepers, Colours=RGB(255, 20, 147), Size=Slider(1, range=0..10), SpriteType=0)
